# Dynamo graph 01_Basic-GET-Request.dyn (Dynamo 3.5.2.8856)
# packages: JsonData 2.0.2

string = StringInput("https://jsonplaceholder.typicode.com/posts/1")
# note: DynaFetch Sample 1: Basic GET Request - Retrieves a single post from JSONPlaceholder API
create = DynaFetch.Nodes.ClientNodes.Create()
string_2 = StringInput("https://xkcd.com/info.0.json")
GET = DynaFetch.Nodes.ExecuteNodes.GET(client=create, url=string_2)
toDictionary = DynaFetch.Nodes.JsonNodes.ToDictionary(response=GET)
watch = Watch(toDictionary)
getContent = DynaFetch.Nodes.JsonNodes.GetContent(response=GET)
string_3 = JsonData.Utilities.Parse.String(jsonString=getContent)
toDictionary_2 = JsonData.Elements.JsonObject.ToDictionary(jsonObject=string_3)
byDictionary = JsonData.Elements.JsonObject.ByDictionary(dictionary=toDictionary_2)
keys = JsonData.Elements.JsonObject.Keys(jsonObject=string_3)
getValueByKey = JsonObject.GetValueByKey(jsonObject=byDictionary, keys=keys, Nesting=true, Option="None")
watch_2 = Watch(getValueByKey)
code_block = CodeBlock { 8; }
getItemAtIndex = List.GetItemAtIndex(list=watch_2, index=code_block)
python_script = Python(IN[0]=getItemAtIndex)  # CPython3
# ---------- python_script.python (19 lines) ----------
# Importing required libraries
import urllib.request

# Adding information about user agent
opener=urllib.request.build_opener()
opener.addheaders=[('User-Agent','Mozilla/5.0 (Windows NT 6.1; WOW64) AppleWebKit/537.36 (KHTML, like Gecko) Chrome/36.0.1941.0 Safari/537.36')]
urllib.request.install_opener(opener)

current_url = IN[0]

# setting filename and image URL
filename = r"C:\Users\CarlStorms\Downloads\DynaFetch\WIP_DYN_Samples\Fun\Fun Images\current_comic.jpg"

image_url = current_url

# calling urlretrieve function to get resource
urllib.request.urlretrieve(image_url, filename)

OUT = image_url
# ----------------------------------------
watch_3 = Watch(python_script)
