# Dynamo graph 02_Authenticated-API.dyn (Dynamo 3.5.2.8856)

# note: DynaFetch Sample 2: Authenticated API - Uses Bearer token for protected endpoints
create = DynaFetch.Nodes.ClientNodes.Create()
code_block = CodeBlock { "Authorization"; }
code_block_2 = CodeBlock { "Bearer demo-token"; }
addDefaultHeader = DynaFetch.Nodes.ClientNodes.AddDefaultHeader(client=create, headerName=code_block, headerValue=code_block_2)
code_block_3 = CodeBlock { "https://httpbin.org/bearer"; }
GET = DynaFetch.Nodes.ExecuteNodes.GET(client=addDefaultHeader, url=code_block_3)
toDictionary = DynaFetch.Nodes.JsonNodes.ToDictionary(response=GET)
watch = Watch(toDictionary)
