# Dynamo graph 03_POST-Data-Submission.dyn (Dynamo 3.5.2.8856)

create = DynaFetch.Nodes.ClientNodes.Create()
# note: DynaFetch Sample 3: POST Data Submission - Creates and submits JSON data to API
code_block = CodeBlock { "https://jsonplaceholder.typicode.com/posts"; }
code_block_2 = CodeBlock { ["title", "body", "userId"]; }
code_block_3 = CodeBlock { ["My Test Post", "This is test content from DynaFetch", 1]; }
byKeysValues = DesignScript.Builtin.Dictionary.ByKeysValues(keys=code_block_2, values=code_block_3)
dictionaryToJson = DynaFetch.Nodes.JsonNodes.DictionaryToJson(dictionary=byKeysValues)
POST = DynaFetch.Nodes.ExecuteNodes.POST(client=create, url=code_block, jsonData=dictionaryToJson)
toDictionary = DynaFetch.Nodes.JsonNodes.ToDictionary(response=POST)
watch = Watch(toDictionary)
