# Dynamo graph 04_Multi-Step-Workflow.dyn (Dynamo 3.5.2.8856)

# note: DynaFetch Sample 4: Multi-Step Workflow - GET data, modify it, PUT update back to API
create = DynaFetch.Nodes.ClientNodes.Create()
code_block = CodeBlock { "https://jsonplaceholder.typicode.com/posts/1"; }
code_block_2 = CodeBlock { "Authorization"; }
code_block_3 = CodeBlock { "Bearer demo-token"; }
addDefaultHeader = DynaFetch.Nodes.ClientNodes.AddDefaultHeader(client=create, headerName=code_block_2, headerValue=code_block_3)
GET = DynaFetch.Nodes.ExecuteNodes.GET(client=addDefaultHeader, url=code_block)
toDictionary = DynaFetch.Nodes.JsonNodes.ToDictionary(response=GET)
code_block_4 = CodeBlock { "title"; }
code_block_5 = CodeBlock { "Updated: "; }
code_block_6 = CodeBlock { "title"; }
valueAtKey = DesignScript.Builtin.Dictionary.ValueAtKey(dictionary=toDictionary, key=code_block_6)
concat = String.Concat(string0=code_block_5, string1=valueAtKey)
setValueAtKeys = DesignScript.Builtin.Dictionary.SetValueAtKeys(dictionary=toDictionary, keys=code_block_4, values=concat)
dictionaryToJson = DynaFetch.Nodes.JsonNodes.DictionaryToJson(dictionary=setValueAtKeys)
PUT = DynaFetch.Nodes.ExecuteNodes.PUT(client=create, url=code_block, jsonData=dictionaryToJson)
toDictionary_2 = DynaFetch.Nodes.JsonNodes.ToDictionary(response=PUT)
watch = Watch(toDictionary_2)
