# Dynamo graph 05_Error-Handling-Pattern.dyn (Dynamo 3.5.2.8856)

# note: DynaFetch Sample 5: Error Handling - Demonstrates graceful error handling with 404 response
create = DynaFetch.Nodes.ClientNodes.Create()
# note: The sample shows:
# 1) JsonNodes.IsValid correctly returns false (no valid JSON)
# 2) JsonNodes.ToDictionary handles the error gracefully (doesn't crash)
# 3) JsonNodes.GetContent returns empty (no content in 404 response)
# 4) Response preview (Watch node) shows clear error info: "404 NOT FOUND | text/html | 0 bytes"
code_block = CodeBlock { "https://httpbin.org/status/404"; }
GET = DynaFetch.Nodes.ExecuteNodes.GET(client=create, url=code_block)
getContent = DynaFetch.Nodes.JsonNodes.GetContent(response=GET)
watch = Watch(getContent)
toDictionary = DynaFetch.Nodes.JsonNodes.ToDictionary(response=GET)
watch_2 = Watch(toDictionary)
isValid = DynaFetch.Nodes.JsonNodes.IsValid(response=GET)
watch_3 = Watch(isValid)
watch_4 = Watch(GET)
