# Dynamo graph 06_JSON-Processing-Demo.dyn (Dynamo 3.5.2.8856)

# group: Single user object → Dictionary
# note: DynaFetch Sample 6: JSON Processing - Demonstrates object/array conversion, formatting, validation, and raw content access
create = DynaFetch.Nodes.ClientNodes.Create()
code_block = CodeBlock { "https://jsonplaceholder.typicode.com/users/1"; }
GET = DynaFetch.Nodes.ExecuteNodes.GET(client=create, url=code_block)
toDictionary = DynaFetch.Nodes.JsonNodes.ToDictionary(response=GET)
watch = Watch(toDictionary)

# group: Multiple users → List
create_2 = DynaFetch.Nodes.ClientNodes.Create()
code_block_2 = CodeBlock { "https://jsonplaceholder.typicode.com/users"; }
GET_2 = DynaFetch.Nodes.ExecuteNodes.GET(client=create_2, url=code_block_2)
toList = DynaFetch.Nodes.JsonNodes.ToList(response=GET_2)
watch_2 = Watch(toList)

# group: Format JSON for readable debugging
format = DynaFetch.Nodes.JsonNodes.Format(response=GET)
watch_3 = Watch(format)

# group: Access raw JSON string content
getContent = DynaFetch.Nodes.JsonNodes.GetContent(response=GET)
watch_4 = Watch(getContent)

# group: Validate JSON before processing
isValid = DynaFetch.Nodes.JsonNodes.IsValid(response=GET)
watch_5 = Watch(isValid)
