# Dynamo graph Basic-GET-Request.dyn (Dynamo 3.5.2.8856)

# note: DynaFetch Sample 1: Basic GET Request - Retrieves a single post from JSONPlaceholder API
create = DynaFetch.Nodes.ClientNodes.Create()
string = StringInput("https://jsonplaceholder.typicode.com/posts/1")
GET = DynaFetch.Nodes.ExecuteNodes.GET(client=create, url=string)
toDictionary = DynaFetch.Nodes.JsonNodes.ToDictionary(response=GET)
watch = Watch(toDictionary)
