# Dynamo graph 01_Basic-GET-Request.dyn (Dynamo 3.5.2.8856)

# group: 1. Input
# note: DynaFetch Sample 1 - Basic GET Request
# This sample demonstrates the simplest possible HTTP request pattern using DynaFetch.
# Perfect for beginners to understand the core workflow of web requests in Dynamo.
# Pattern: Create Client & URL → Execute Request → Process Response
create = DynaFetch.Nodes.ClientNodes.Create()
# note: HTTP Client Setup & Target URL
# The ClientNodes.Create node creates an HTTP client that handles the actual
# communication with web servers. This client can be reused for multiple requests,
# making it efficient for workflows that need several API calls.
# All web requests start with a URL - this is your target endpoint.
string = StringInput("https://jsonplaceholder.typicode.com/posts/1")

# group: 2. Build & Execute
# note: Request Execution
# The ExecuteNodes.GET node in the DynaFetch library takes the HTTP client
# and URL, then executes the web request to the URL provided.
# This node always builds a GET request - the most common HTTP method
# for retrieving data from servers.
GET = DynaFetch.Nodes.ExecuteNodes.GET(client=create, url=string)

# group: 3. Response
toDictionary = DynaFetch.Nodes.JsonNodes.ToDictionary(response=GET)
watch = Watch(toDictionary)
# note: Response Processing & JSON Handling
# The HttpResponse object contains all response data and metadata.
# For JSON responses, you have two main options:
# - JsonNodes.ToDictionary - Converts JSON into Dynamo Dictionary objects.
#   Use this when you need to access specific properties or manipulate the data
#   within Dynamo. Best for structured data processing.
# note: - JsonNodes.GetContent - Returns the raw JSON string content.
#   Use this when you need the original JSON format or want to pass the
#   data to other systems without modification.
# Choose based on whether you need structured data access (ToDictionary)
# or raw content (GetContent).
getContent = DynaFetch.Nodes.JsonNodes.GetContent(response=GET)
