# Dynamo graph 02_Authenticated-API.dyn (Dynamo 3.5.2.8856)

# group: 1. Input
# note: DynaFetch Sample 2 - Authenticated API Requests
# This sample demonstrates how to authenticate with APIs using Bearer tokens.
# Shows the client-level authentication pattern that persists across multiple requests.
# Perfect for APIs that require authorization headers like OAuth, JWT tokens, or API keys.
# Pattern: Create Client → Add Auth Header → Execute Request → Process Response
# API: httpbin.org/bearer (validates Bearer token authentication)
create = DynaFetch.Nodes.ClientNodes.Create()
code_block = CodeBlock { "Authorization"; }
# note: HTTP Client Creation
# The ClientNodes.Create node establishes the foundation HTTP client.
# This client will hold authentication credentials and can be reused
# for multiple authenticated requests efficiently.
# Client-level authentication is more secure and efficient than
# adding auth headers to individual requests.
code_block_2 = CodeBlock { "Bearer demo-token"; }

# group: 2. Build & Execute
addDefaultHeader = DynaFetch.Nodes.ClientNodes.AddDefaultHeader(client=create, headerName=code_block, headerValue=code_block_2)
# note: Authentication Setup & Request Execution
# ClientNodes.AddDefaultHeader configures persistent authentication:
# - Header: "Authorization"
# - Value: "Bearer demo-token" (use real tokens in production)
# - Scope: Client-level (applies to all requests from this client)
# ExecuteNodes.GET executes the authenticated request:
# - Uses the configured client with built-in authentication
# - Automatically includes the Authorization header
# - Returns HttpResponse with authentication results
# Client-level auth means you set it once and all subsequent
# requests automatically include the credentials.
code_block_3 = CodeBlock { "https://httpbin.org/bearer"; }
GET = DynaFetch.Nodes.ExecuteNodes.GET(client=addDefaultHeader, url=code_block_3)

# group: 3. Response
# note: Direct JSON Processing & Authentication Validation
# JsonNodes.ToDictionary converts the authentication response directly
# from the HttpResponse to structured Dictionary data:
# For successful authentication (httpbin.org/bearer response):
# - "authenticated": true/false status
# - "token": echoed token value for verification
# - "user": user information (if applicable)
# This direct conversion pattern is efficient for JSON APIs:
# - Skips intermediate content extraction step
# - Automatically handles JSON parsing
# - Provides immediate access to structured auth data
# - Enables conditional logic based on authentication status
# Dictionary format makes auth results ready for immediate use
# in subsequent Dynamo operations and decision making.
toDictionary = DynaFetch.Nodes.JsonNodes.ToDictionary(response=GET)
watch = Watch(toDictionary)
