# Dynamo graph 03_POST-Data-Submission.dyn (Dynamo 3.5.2.8856)

# note: DynaFetch Sample 3 - POST Data Submission
# This sample demonstrates how to submit data to APIs using POST requests.
# Shows the complete workflow from data preparation to response processing.
# Perfect for creating records, submitting forms, or sending structured data to APIs.
# Pattern: Prepare Data → Convert to JSON → POST Request → Process Response
# API: JSONPlaceholder posts (creates new post records)

# group: 1. Input
create = DynaFetch.Nodes.ClientNodes.Create()
# note: Testing Endpoint - JSONPlaceholder
# JSONPlaceholder /posts endpoint simulates record creation:
# - Accepts standard post data (title, body, userId)
# - Returns created record with new ID
# - Perfect for testing POST workflows safely
# - Real APIs follow similar patterns
# Use this pattern with your production API endpoints.
code_block = CodeBlock { "https://jsonplaceholder.typicode.com/posts"; }
# note: Data Preparation & Client Setup
# Dictionary.ByKeysValues creates structured data for submission:
# - Keys: Field names that the API expects ["title", "body", "userId"]
# - Values: Actual data to submit ["Test Post", "Content", 1]
# - Result: Dynamo Dictionary ready for JSON conversion
# ClientNodes.Create establishes the HTTP client for the POST request.
# Data structure matches the target API's expected format.
# This approach works for any API that accepts JSON data.
code_block_2 = CodeBlock { ["title", "body", "userId"]; }
code_block_3 = CodeBlock { ["My Test Post", "This is test content from DynaFetch", 1]; }
byKeysValues = DesignScript.Builtin.Dictionary.ByKeysValues(keys=code_block_2, values=code_block_3)

# group: 2. Build & Execute
# note: JSON Conversion & POST Execution
# JsonNodes.DictionaryToJson converts Dynamo data to JSON format:
# - Takes Dictionary input and creates valid JSON string
# - Handles proper escaping and formatting automatically
# - Ensures data is in the format APIs expect
# - Required step for most modern API data submission
# ExecuteNodes.POST submits the JSON data:
# - Client: HTTP client for the request
# - URL: Target endpoint for data creation
# - Body: JSON string containing the data to submit
# - Content-Type: Automatically set to "application/json"
# POST is the standard HTTP method for creating new resources.
# note: Notes About: ExecuteNodes.POST
# POST Request Execution
# POST differs from GET in several important ways:
# - Includes request body with data to submit
# - Intended for creating/modifying server resources
# - May have side effects (creates records, sends emails, etc.)
# - Content-Type header automatically set to "application/json"
# DynaFetch handles the HTTP protocol details automatically,
# including proper headers and encoding.
dictionaryToJson = DynaFetch.Nodes.JsonNodes.DictionaryToJson(dictionary=byKeysValues)
POST = DynaFetch.Nodes.ExecuteNodes.POST(client=create, url=code_block, jsonData=dictionaryToJson)

# group: 3. Response
# note: Notes About: JsonNodes.DictionaryToJson
# Data Format Conversion
# DictionaryToJson handles the critical conversion from Dynamo's
# native Dictionary format to JSON string format that APIs require:
# - Automatic type conversion (strings, numbers, booleans)
# - Proper JSON formatting and escaping
# - Nested object support for complex data structures
# - UTF-8 encoding for international characters
# This conversion is essential - APIs typically reject raw
# Dictionary objects and require properly formatted JSON.
toDictionary = DynaFetch.Nodes.JsonNodes.ToDictionary(response=POST)
# note: Creation Response Processing
# JsonNodes.ToDictionary processes the API's creation response:
# For successful data submission (JSONPlaceholder response):
# - "id": Newly created record ID (e.g., 101)
# - "title": Echoed title data for confirmation
# - "body": Echoed body content for verification
# - "userId": Echoed user ID for validation
# Response validation enables:
# - Confirmation that data was created successfully
# - Access to new record ID for further operations
# - Verification that submitted data was processed correctly
# - Error detection if submission failed
# The returned ID can be used for subsequent operations like
# updates, deletions, or retrieving the full record.
watch = Watch(toDictionary)
