# Dynamo graph 04_Multi-Step-Workflow.dyn (Dynamo 3.5.2.8856)

# group: 1. Input
# note: DynaFetch Sample 4 - Multi-Step Authenticated Workflow
# This sample demonstrates a complete CRUD workflow: authenticate, retrieve data,
# modify it, and update the server. Shows how to chain operations together.
# Perfect for business workflows that require data retrieval, processing, and updating.
# Pattern: Auth Setup → GET/Modify/PUT → Process Response → Validate Update
# API: JSONPlaceholder posts (retrieves post, updates title with "Updated:" prefix)
create = DynaFetch.Nodes.ClientNodes.Create()
code_block = CodeBlock { "https://jsonplaceholder.typicode.com/posts/1"; }
code_block_2 = CodeBlock { "Authorization"; }
# note: Authentication & Client Configuration
# ClientNodes.Create establishes the HTTP client foundation.
# ClientNodes.AddDefaultHeader configures persistent authentication:
# - Simulates token-based authentication for protected operations
# - Client-level auth applies to all requests (GET and PUT)
# - Required for APIs that protect both read and write operations
# Multi-step workflows benefit from persistent authentication -
# set it once, use it for all operations in the workflow.
code_block_3 = CodeBlock { "Bearer demo-token"; }
# note: CRUD Workflow Pattern
# This demonstrates the standard "Read-Modify-Write" pattern:
# 1. GET: Retrieve current state
# 2. PROCESS: Modify specific fields
# 3. PUT: Update complete record
# 4. VALIDATE: Confirm successful update
# This pattern ensures data integrity and follows REST API conventions.
addDefaultHeader = DynaFetch.Nodes.ClientNodes.AddDefaultHeader(client=create, headerName=code_block_2, headerValue=code_block_3)

# group: 2. Build & Execute
# note: Complete Multi-Step Operation Sequence
# ExecuteNodes.GET retrieves the current record:
# - Uses authenticated client for protected data access
# - Fetches existing record for modification
# Data Processing & Modification:
# - String operations add "Updated: " prefix to extracted title
# - Dictionary reconstruction prepares complete updated record
# - JsonNodes.DictionaryToJson converts modified data to API format
# ExecuteNodes.PUT submits the updated record:
# - Uses same authenticated client as GET operation
# - Sends complete modified record to update the resource
# - Follows "Read-Modify-Write" pattern for data integrity
# This consolidated execution shows the complete business process
# from data retrieval through modification to final update.
# note: Data Transformation Pipeline
# Shows how to process API data within the workflow:
# - Extract specific values from Dictionary responses
# - Apply business logic transformations
# - Prepare modified data for resubmission
# This pattern scales to any data processing requirements.
GET = DynaFetch.Nodes.ExecuteNodes.GET(client=addDefaultHeader, url=code_block)
toDictionary = DynaFetch.Nodes.JsonNodes.ToDictionary(response=GET)
code_block_4 = CodeBlock { "title"; }
code_block_5 = CodeBlock { "Updated: "; }
code_block_6 = CodeBlock { "title"; }
valueAtKey = DesignScript.Builtin.Dictionary.ValueAtKey(dictionary=toDictionary, key=code_block_6)
concat = String.Concat(string0=code_block_5, string1=valueAtKey)

# group: 3. Response
setValueAtKeys = DesignScript.Builtin.Dictionary.SetValueAtKeys(dictionary=toDictionary, keys=code_block_4, values=concat)
# note: Initial Data Processing & Extraction
# JsonNodes.ToDictionary converts the GET response to structured format.
# Dictionary.ValueAtKey extracts specific fields for modification:
# - "title": Current title that will be updated
# - "id": Record identifier needed for PUT operation
# - Other fields: Available for preservation in update
# This response processing enables:
# - Selective field modification without data loss
# - Validation of retrieved data before processing
# - Extraction of identifiers needed for subsequent operations
dictionaryToJson = DynaFetch.Nodes.JsonNodes.DictionaryToJson(dictionary=setValueAtKeys)
PUT = DynaFetch.Nodes.ExecuteNodes.PUT(client=create, url=code_block, jsonData=dictionaryToJson)

# group: 4. Deserialize
# note: Update Confirmation & Validation
# Final JsonNodes.ToDictionary processes the PUT response:
# - Confirms the update operation was successful
# - Returns the updated record with applied modifications
# - Enables verification that changes were processed correctly
# Successful PUT response typically includes:
# - Updated record with new "Updated: " title prefix
# - Preserved original data in other fields
# - Confirmation metadata (timestamps, version info)
# This validation step ensures the multi-step workflow
# completed successfully and data was updated as expected.
toDictionary_2 = DynaFetch.Nodes.JsonNodes.ToDictionary(response=PUT)
watch = Watch(toDictionary_2)
