# Dynamo graph 05_Error-Handling-Pattern.dyn (Dynamo 3.5.2.8856)

# group: 1. Input
# note: DynaFetch Sample 5 - Error Handling Pattern
# This sample demonstrates how to handle API errors gracefully instead of letting
# workflows fail. Shows proper error detection and user-friendly error processing.
# Essential for production workflows that need to handle network issues,
# missing resources, or API failures without breaking.
# Pattern: Request → Check Status → Validate Response → Handle Errors Gracefully
# API: httpbin.org/status/404 (deliberately returns 404 error for testing)
create = DynaFetch.Nodes.ClientNodes.Create()
# note: Error Scenario Setup
# ClientNodes.Create establishes the HTTP client for error testing.
# Target URL: httpbin.org/status/404
# - Deliberately returns HTTP 404 "Not Found" status
# - Simulates common API error scenario (missing resource)
# - Safe testing endpoint for error handling development
# Real workflows should include error handling for:
# - Network connectivity issues
# - Authentication failures (401/403)
# - Resource not found (404)
# - Server errors (500/502/503)
# - Timeout scenarios
code_block = CodeBlock { "https://httpbin.org/status/404"; }

# group: 2. Build & Execute
# note: Controlled Error Request
# ExecuteNodes.GET executes request that will fail:
# - Target endpoint specifically returns 404 status
# - DynaFetch handles the error gracefully (no exceptions thrown)
# - Returns HttpResponse object with error information
# - Workflow continues instead of crashing
# Key advantage: DynaFetch treats HTTP errors as valid responses
# rather than exceptions, enabling proper error handling workflows.
# note: Note about: ExecuteNodes.GET
# Error-Safe Request Execution
# DynaFetch design philosophy:
# - HTTP errors return HttpResponse objects (not exceptions)
# - Workflows continue executing instead of crashing
# - Comprehensive error information available for handling
# - Enables building resilient, production-ready workflows
# This approach is superior to exception-based error handling
# for workflow environments like Dynamo.
# note: Production Error Handling
# Real-world error handling patterns:
# - Retry transient errors (network timeouts)
# - Cache successful responses for offline scenarios
# - Provide meaningful error messages to users
# - Log errors for monitoring and debugging
# - Graceful degradation when services are unavailable
# Build resilient workflows that handle errors professionally.
GET = DynaFetch.Nodes.ExecuteNodes.GET(client=create, url=code_block)

# group: 3. Response
# note: Error Detection & Status Analysis
# HttpResponse provides comprehensive error information:
# Status Code Analysis:
# - HttpResponse.StatusCode: "NotFound" (enumeration value)
# - HttpResponse.StatusCodeNumber: 404 (numeric value)
# - HttpResponse.IsSuccess: false (boolean indicator)
# - HttpResponse.IsError: true (boolean indicator)
# Additional Error Context:
# - HttpResponse.StatusDescription: Human-readable error description
# - HttpResponse.Headers: Server response headers
# - HttpResponse.RequestUrl: Confirms which request failed
# This rich error information enables intelligent error handling
# and user-friendly error messages instead of cryptic failures.
getContent = DynaFetch.Nodes.JsonNodes.GetContent(response=GET)
# note: Graceful Error Handling
# Conditional Logic Based on Response Status:
# - Use IsSuccess/IsError properties for branching logic
# - Process successful responses normally
# - Handle errors with appropriate fallback behavior
# Error Handling Strategies:
# - Display user-friendly error messages
# - Retry logic for temporary failures
# - Fallback to cached or default data
# - Log errors for debugging while continuing workflow
# Example Error Processing:
# - If IsError = true: Show "Resource not found, using default data"
# - If IsSuccess = true: Process response normally
# - Status-specific handling: Different actions for 404 vs 500 errors
# This pattern prevents workflow crashes and provides
# better user experience when API issues occur.
watch = Watch(getContent)
toDictionary = DynaFetch.Nodes.JsonNodes.ToDictionary(response=GET)
watch_2 = Watch(toDictionary)
isValid = DynaFetch.Nodes.JsonNodes.IsValid(response=GET)
# note: The sample shows in the Orange group
#  (3. Response)
# 1) JsonNodes.IsValid correctly returns false (no valid JSON)
# 2) JsonNodes.ToDictionary handles the error gracefully (doesn't crash)
# 3) Response preview (Watch node) shows clear error info: "404 NOT FOUND | text/html | 0 bytes"
# 4) JsonNodes.GetContent returns empty (no content in 404 response)
watch_3 = Watch(isValid)
watch_4 = Watch(GET)
