# Dynamo graph 06_JSON-Processing-Demo.dyn (Dynamo 3.5.2.8856)

# note: DynaFetch Sample 6 - Comprehensive JSON Processing
# This sample demonstrates all available JSON processing methods in DynaFetch.
# Shows how to handle different JSON response types and choose the right processing method.
# Essential for understanding when to use each JSON processing approach
# for different API response formats and workflow requirements.
# Pattern: Multiple Requests → Raw Content → Structured Processing → Validation
# APIs: JSONPlaceholder user (object) and users (array) endpoints
# note: API Response Pattern Comparison
# Single Object (/users/1):
# {"id": 1, "name": "John", "email": "john@example.com"}
# Array Response (/users):
# [{"id": 1, "name": "John"}, {"id": 2, "name": "Jane"}]
# Different structures require different processing methods -
# this sample shows how to handle both patterns effectively.

# group: 1. Input
create = DynaFetch.Nodes.ClientNodes.Create()
code_block = CodeBlock { "https://jsonplaceholder.typicode.com/users/1"; }
# note: Multiple JSON Endpoint Configuration
# ClientNodes.Create establishes shared HTTP client for efficiency.
# Two different JSON response types for comprehensive demonstration:
# - /users/1: Single user object (JSON object response)
# - /users: All users array (JSON array response)
# This dual approach shows how to handle both:
# - Individual records (objects) - most common API pattern
# - Collections (arrays) - for bulk data retrieval
# Same client handles both request types efficiently.
code_block_2 = CodeBlock { "https://jsonplaceholder.typicode.com/users"; }

# group: 2. Build & Execute
GET = DynaFetch.Nodes.ExecuteNodes.GET(client=create, url=code_block)
# note: Parallel JSON Data Retrieval
# Multiple ExecuteNodes.GET requests demonstrate concurrent processing:
# - Single Object Request: Fetches one user record
# - Array Request: Fetches collection of all users
# - Both execute simultaneously for efficiency
# Each request returns HttpResponse containing JSON data
# in different structures, requiring different processing approaches.
# This pattern shows how to efficiently retrieve multiple
# JSON datasets in parallel for comprehensive processing.
GET_2 = DynaFetch.Nodes.ExecuteNodes.GET(client=create, url=code_block_2)

# group: 3. Response: Single user object → Dictionary
# note: Complete JSON Processing Method Demonstration
# JsonNodes.ToDictionary (Object Processing):
# - Converts single user JSON to Dynamo Dictionary
# - Enables property access via Dictionary.ValueAtKey
# - Best for individual records and structured data access
# Object Processing Best Practice
# ToDictionary converts JSON objects to Dynamo's native Dictionary type:
# - Enables seamless integration with Dynamo workflows
# - Provides type-safe property access
# - Supports nested object structures
# - Automatic type conversion (strings, numbers, booleans)
# Use for individual records where you need to access specific properties.
toDictionary = DynaFetch.Nodes.JsonNodes.ToDictionary(response=GET)
watch = Watch(toDictionary)

# group: 3. Response: Multiple users → List
# note: Complete JSON Processing Method Demonstration
# JsonNodes.ToList (Array Processing):
# - Converts users array JSON to Dynamo List
# - Each list item is a Dictionary representing one user
# - Best for collections and bulk data processing
# JSON Utility Methods
# Format: Creates human-readable JSON for:
# - Debugging complex API responses
# - Documentation and examples
# - User display of structured data
# IsValid: Validates JSON syntax for:
# - Error handling with unpredictable APIs
# - Conditional processing based on data quality
# - Workflow branching for valid vs invalid responses
# These utilities enhance workflow robustness and debugging capabilities.
toList = DynaFetch.Nodes.JsonNodes.ToList(response=GET_2)
watch_2 = Watch(toList)

# group: 3. Response: Format JSON for readable debugging
# note: Complete JSON Processing Method Demonstration
# JsonNodes.Format (Pretty Printing):
# - Formats JSON with proper indentation and line breaks
# - Useful for debugging, documentation, or display
# - Makes complex JSON readable and analyzabl
# JSON Utility Methods
# These utilities enhance workflow robustness and debugging capabilities.
# Format: Creates human-readable JSON for:
# - Debugging complex API responses
# - Documentation and examples
# - User display of structured data
format = DynaFetch.Nodes.JsonNodes.Format(response=GET)
watch_3 = Watch(format)

# group: 3. Response: Validate JSON before processing
# note: Complete JSON Processing Method Demonstration
# JsonNodes.IsValid (Validation):
# - Checks if response contains valid JSON syntax
# - Returns true/false for conditional processing
# - Essential for error handling with uncertain data sources
# JSON Utility Methods
# These utilities enhance workflow robustness and debugging capabilities.
# IsValid: Validates JSON syntax for:
# - Error handling with unpredictable APIs
# - Conditional processing based on data quality
# - Workflow branching for valid vs invalid responses
isValid = DynaFetch.Nodes.JsonNodes.IsValid(response=GET)
watch_4 = Watch(isValid)

# group: 3. Response: Access raw JSON string content
# note: Raw JSON Content Access
# JsonNodes.GetContent extracts raw JSON strings:
# - Returns unprocessed JSON text from HttpResponse
# - Useful for debugging, logging, or external processing
# - Shows actual API response format
# - Required for custom JSON processing or validation
# Raw content access enables:
# - JSON format inspection and debugging
# - Custom parsing for non-standard formats
# - Response logging for API monitoring
# - Integration with external JSON processing tools
getContent = DynaFetch.Nodes.JsonNodes.GetContent(response=GET)
watch_5 = Watch(getContent)
