# Dynamo graph 07_Fun-GET-Random-Ron_Swanson_Quote.dyn (Dynamo 3.5.2.8856)

# group: 1. Input
# note: DynaFetch Sample 7 - Fun GET Request
# Get a Random Ron Swanson Quote!
# Pattern: Create Client & URL → Execute Request → Process Response
# This sample demonstrates the simplest possible DynaFetch workflow using a fun public API. The Ron Swanson Quotes API (https://ron-swanson-quotes.herokuapp.com/v2/quotes) returns random quotes from the Parks and Recreation character, showing how DynaFetch handles basic GET requests with minimal setup.
create = DynaFetch.Nodes.ClientNodes.Create()
# note: Simple API Setup
# DynaFetch's streamlined approach to API requests:
# - ClientNodes.Create - No configuration needed for basic requests
# - String input with API endpoint URL
# - No authentication required for public APIs
# Pattern: Create Client → Set URL → Execute Request
# Perfect for simple GET requests to public APIs and testing endpoints.
string = StringInput("https://ron-swanson-quotes.herokuapp.com/v2/quotes")

# group: 2. Build & Execute
# note: GET Request Execution
# ExecuteNodes.GET demonstrates DynaFetch's simple execution pattern:
# - Two inputs: client and URL
# - Automatic HTTP protocol handling
# - Returns HttpResponse object for further processing
# Single-node execution vs multi-step request building
# Shows DynaFetch's efficiency for straightforward API calls.
# note: Key Learning Points:
# - No authentication needed for public APIs
# - Single ExecuteNodes.GET call handles the entire request
# - JsonNodes.GetContent extracts raw response content
# - Three-node pattern works for most simple API integrations
# This pattern can be applied to any public API that returns data via GET requests. Try replacing the URL with other fun APIs like Chuck Norris jokes, cat facts, or random advice!
GET = DynaFetch.Nodes.ExecuteNodes.GET(client=create, url=string)

# group: 3. Response - Random Ron Swanson Quote
# note: Raw Response Processing
# JsonNodes.GetContent extracts the actual API response:
# - Returns the raw string content from the HTTP response
# - Bypasses JSON parsing for simple text responses
# - Direct access to API data without additional processing
# Watch node displays the random quote directly
# Perfect for APIs that return plain text or simple string responses.
getContent = DynaFetch.Nodes.JsonNodes.GetContent(response=GET)
watch = Watch(getContent)
