# Dynamo graph 1 - First-Request-DynaFetch.dyn (Dynamo 3.5.2.8856)

# group: 1. Input
# note: DynaFetch Migration Sample
# Original: "Dynamo 2.0 - First Request" from DynaWeb
# This graph recreates the original Dynamo 2.0 sample from DynaWeb using DynaFetch nodes. DynaFetch is a modern REST API package that works with Dynamo 3.0+ and provides the same functionality as DynaWeb with improved performance and simplified workflows.
# Original DynaWeb sample by Radu Gidei - recreated for DynaFetch compatibility.
create = DynaFetch.Nodes.ClientNodes.Create()
# note: All web requests start with a web address, also known as a URL.
# This is what you typically type into the address bar of your web browser. DynaFetch also requires creating an HTTP client to handle the connection.
string = StringInput("http://www.google.com/")

# group: 2. Build & Execute
# note: The "ExecuteNodes.GET" node in the DynaFetch library simply executes the web request to the URL provided. It returns an HttpResponse object.
GET = DynaFetch.Nodes.ExecuteNodes.GET(client=create, url=string)

# group: 3. Response
# note: The HttpResponse.GetContent node returns the actual content returned from the server.
# In this example, it's the HTML content returned by the Google.com address. A browser would take this HTML markup and represent it graphically as a webpage.
getContent = DynaFetch.Core.HttpResponse.GetContent(httpResponse=GET)
watch = Watch(getContent)
