# Dynamo graph 2 - Simple-Request-DynaFetch.dyn (Dynamo 3.5.2.8856)

# note: DynaFetch Migration Sample
# Original: "Dynamo 2.0 - Simple Request" from DynaWeb
# This graph recreates the original Dynamo 2.0 sample from DynaWeb using DynaFetch nodes. DynaFetch is a modern REST API package that works with Dynamo 3.0+ and provides the same functionality as DynaWeb with improved performance and simplified workflows.
# Original DynaWeb sample by Radu Gidei - recreated for DynaFetch compatibility.

# group: 2. Executing the request
# note: The next step is to retrieve the page/data from the web address. This process is known as executing a web request.
# To do this, a few steps are followed:
# - a web request is built from the URL provided
# - the request is executed
# - the server contacted, or remote website you're requesting from provides a Response
# - the request or built returns the Response
# note: Web requests can be executed with a few different methods, with the 4 most used being:
# - GET: this gets data from the server
# - POST: this sends information to the server
# For example, in a web page, your browser sends a GET request to the address you're trying to view. On the other hand, when you're submitting a form (such as logging in to a site, or posting something on social media), your browser sends a POST request to the URL address.

# group: 3. Response from server
# note: Once a request is sent to a server will send back a response. This indicates how the process is going.
# The server processes the request, gathering all the data needed:
# - the server sends the data to the requesting
# - the request is completed and the data returned from the server is available
# note: Responses from servers can come in many different shapes and sizes and also have some meta-data:
# - response status code
# - headers, cookies & etc
# - content
# A status of 200 means your request was completed successfully (if you see a 200 code, you likely received the response data). Status code returned by the server and each number has a different meaning. For example:
# - 200 = all ok
# - 404 = can't find what you requested
# - 500 = server could not return your data due to an internal fault
# For more HTTP status codes, see this wiki: https://en.wikipedia.org/wiki/List_of_HTTP_status_codes

# group: 1. Input
# note: The "ClientNodes.Create" node creates an HTTP client that handles the actual communication with web servers.
# This client manages connection settings like timeouts, security protocols, and can store authentication headers that will be used for all requests. Once created, the same client can be reused for multiple requests, making it efficient for workflows that call several APIs.
# In DynaFetch, every web request needs a client - this separates the connection management from the individual requests, giving you more control over how your HTTP communications are handled.
create = DynaFetch.Nodes.ClientNodes.Create()
# note: All web requests start with a web address, also known as a URL.
# This is what you typically type into the address bar of your web browser. DynaFetch also requires creating an HTTP client to handle the connection.
# I suggest using something like JSONPlaceholder to test out the package and web responses.
# https://jsonplaceholder.typicode.com
# Visit the site to generate a fresh URL, this one will likely be out of date.
string = StringInput("http://www.google.com/")
string_2 = StringInput("https://jsonplaceholder.typicode.com/users/1")

# group: Build & Execute
# note: The "ExecuteNodes.GET" node in the DynaFetch library builds a web request to the URL provided and executes it as well.
# The node always builds a GET request.
GET = DynaFetch.Nodes.ExecuteNodes.GET(client=create, url=string)

# group: Response
# note: The "HttpResponse.GetContent" node from the DynaFetch library returns the content of the web response by default and none of the metadata.
# This means the response does not need to be unwrapped using a Response node and can be fed directly into a watch.
getContent = DynaFetch.Core.HttpResponse.GetContent(httpResponse=GET)
watch = Watch(getContent)

# group: Dynamo Core Node
# note: The "Web Request" node in the Core Dynamo library :
# - builds a web request to the URL provided
# - executes it as well.
# The node always builds a GET request.
web_request = WebRequest(url=string)

# group: Response
watch_2 = Watch(web_request)

# group: Build & Execute
# note: The "ExecuteNodes.GET" node in the DynaFetch library builds a web request to the URL provided and executes it as well.
# The node always builds a GET request.
GET_2 = DynaFetch.Nodes.ExecuteNodes.GET(client=create, url=string_2)

# group: Response
# note: In this example, the server does not return HTML to us, but a simple key-value encoded as JSON.
# This type of response is returned by web services, APIs, etc and is intended to be converted into usable data. Imagine, for instance, that this data contains information about people. The process of converting this from text (JSON) begins with Deserializing.
toDictionary = DynaFetch.Nodes.JsonNodes.ToDictionary(response=GET_2)
watch_3 = Watch(toDictionary)
