# Dynamo graph 3 - Simple-Request-Benchmarking-DynaFetch.dyn (Dynamo 3.5.2.8856)

# note: DynaFetch Migration Sample
# Original: "Dynamo 2.0 - Simple Request with Benchmarking" from DynaWeb
# This graph recreates the original Dynamo 2.0 sample from DynaWeb using DynaFetch nodes. DynaFetch is a modern REST API package that works with Dynamo 3.0+ and provides the same functionality as DynaWeb with improved performance and simplified workflows.
# Original DynaWeb sample by Radu Gidei - recreated for DynaFetch compatibility.

# group: 2. Executing the request
# note: Web requests can be executed with a few different methods, with the 4 most used being:
# - GET: this gets data from the server
# - POST: this sends information to the server
# For example, in a web page, your browser sends a GET request to the address you're trying to view. On the other hand, when you're submitting a form (such as logging in to a site, or posting something on social media), your browser sends a POST request to the URL address.
# note: The next step is to retrieve the page/data from the web address. This process is known as executing a web request.
# To do this, a few steps are followed:
# - a web request is built from the URL provided
# - the request is executed
# - the server contacted, or remote website you're requesting from provides a Response
# - the request or built returns the Response

# group: 3. Response from server
# note: Once a request is sent to a server will send back a response. This indicates how the process is going.
# The server processes the request, gathering all the data needed:
# - the server sends the data to the requesting
# - the request is completed and the data returned from the server is available
# note: Responses from servers can come in many different shapes and sizes and also have some meta-data:
# - response status code
# - headers, cookies & etc
# - content
# A status of 200 means your request was completed successfully (if you see a 200 code, you likely received the response data). Status code returned by the server and each number has a different meaning. For example:
# - 200 = all ok
# - 404 = can't find what you requested
# - 500 = server could not return your data due to an internal fault
# For more HTTP status codes, see this wiki: https://en.wikipedia.org/wiki/List_of_HTTP_status_codes

# group: 1. Input
create = DynaFetch.Nodes.ClientNodes.Create()
# note: All web requests start with a web address, also known as a URL.
# This sample demonstrates comprehensive response analysis by making requests to multiple endpoints and extracting detailed response metadata for performance and debugging analysis.
# The HTTP client handles connection management and can be reused for multiple requests efficiently.
# note: The "ClientNodes.Create" node creates an HTTP client that handles the actual communication with web servers.
# This client manages connection settings like timeouts, security protocols, and can store authentication headers that will be used for all requests. Once created, the same client can be reused for multiple requests, making it efficient for workflows that call several APIs.
# In DynaFetch, every web request needs a client - this separates the connection management from the individual requests, giving you more control over how your HTTP communications are handled.
string = StringInput("https://dynamobim.org/")

# group: Build & Execute
# note: The ExecuteNodes.GET nodes execute HTTP requests and return comprehensive HttpResponse objects containing detailed metadata about the request and response.
# DynaFetch provides extensive response analysis capabilities including status codes, headers, content properties, and success indicators for thorough request debugging and monitoring.
GET = DynaFetch.Nodes.ExecuteNodes.GET(client=create, url=string)

# group: Response Metadata
isSuccess = DynaFetch.Core.HttpResponse.IsSuccess(httpResponse=GET)
watch = Watch(isSuccess)
contentType = DynaFetch.Core.HttpResponse.ContentType(httpResponse=GET)
watch_2 = Watch(contentType)
contentLength = DynaFetch.Core.HttpResponse.ContentLength(httpResponse=GET)
watch_3 = Watch(contentLength)
statusDescription = DynaFetch.Core.HttpResponse.StatusDescription(httpResponse=GET)
watch_4 = Watch(statusDescription)
statusCode = DynaFetch.Core.HttpResponse.StatusCode(httpResponse=GET)
# note: HttpResponse objects in DynaFetch provide comprehensive metadata extraction capabilities:
# - StatusCode & StatusCodeNumber: HTTP status (200=success, 404=not found, etc.)
# - StatusDescription: Human-readable status text
# - Headers: Server response headers with detailed metadata
# - ContentType: MIME type of the response (text/html, application/json, etc.)
# - ContentLength: Size of the response in bytes
# - IsSuccess & IsError: Boolean indicators for quick status checking
# - RequestUrl: Confirmation of the actual URL requested
# This detailed analysis enables performance monitoring, debugging, and comprehensive API response validation.
watch_5 = Watch(statusCode)
statusCodeNumber = DynaFetch.Core.HttpResponse.StatusCodeNumber(httpResponse=GET)
watch_6 = Watch(statusCodeNumber)
headers = DynaFetch.Core.HttpResponse.Headers(httpResponse=GET)
watch_7 = Watch(headers)
requestUrl = DynaFetch.Core.HttpResponse.RequestUrl(httpResponse=GET)
watch_8 = Watch(requestUrl)
isError = DynaFetch.Core.HttpResponse.IsError(httpResponse=GET)
watch_9 = Watch(isError)

# group: Dynamo Core Node
# note: The "Web Request" node in the Core Dynamo library :
# - builds a web request to the URL provided
# - executes it as well.
# The node always builds a GET request.
web_request = WebRequest(url=string)

# group: Response
# note: The "Web Request" node from the Core Dynamo library returns the content of the web response by default and none of the metadata.
# This means the response does not need to be unwrapped using a Response node and can be plugged straight into any other node, such as a Watch.
watch_10 = Watch(web_request)

# group: Response
# note: The "HttpResponse.GetContent" node from the DynaFetch library returns the content of the web response by default and none of the metadata.
# This means the response does not need to be unwrapped using a Response node and can be fed directly into a watch.
getContent = DynaFetch.Core.HttpResponse.GetContent(httpResponse=GET)
watch_11 = Watch(getContent)

# group: 4. Output to Files
# note: Output the content of the web responses to disk.
# The responses from the Dynamo Core node and the DynaWeb library are saved separately, so you can benchmark the potential difference between them.
directory_path = Directory("C:\Users\CarlStorms\Documents")
code_block = CodeBlock { "Response-DynamoCore.html"; "Response-DynaFetch.html"; }
# note: Note :
# The output of these requests is raw HTML, meaning we can save this to a *.html file and open that with our browsers.
# Give it a try, open these files with your web browser!
combinePath = FileSystem.CombinePath(string0=directory_path, string1=code_block.out0)
writeText = FileSystem.WriteText(filePath=combinePath, text=watch_10)
combinePath_2 = FileSystem.CombinePath(string0=directory_path, string1=code_block.out1)
writeText_2 = FileSystem.WriteText(filePath=combinePath_2, text=watch_11)
