# Dynamo graph 4 - REST API Example-DynaFetch.dyn (Dynamo 3.5.2.8856)

# group: Input
create = DynaFetch.Nodes.ClientNodes.Create()
# note: DynaFetch Migration Sample
# Original: "Dynamo 2.0 - REST API Example" from DynaWeb
# This graph recreates the original Dynamo 2.0 sample from DynaWeb using DynaFetch nodes.
# DynaFetch is a modern REST API package that works with Dynamo 3.0+ and provides the
# same functionality as DynaWeb with improved performance and simplified workflows.
# Original DynaWeb sample by Radu Gidei - recreated for DynaFetch compatibility.
string = StringInput("https://jsonplaceholder.typicode.com/users")
string_2 = StringInput("https://jsonplaceholder.typicode.com/users/1")

# group: Build & Execute
GET = DynaFetch.Nodes.ExecuteNodes.GET(client=create, url=string)

# group: Response
getContent = DynaFetch.Core.HttpResponse.GetContent(httpResponse=GET)
watch = Watch(getContent)

# group: Deserialise
jsonToList = DynaFetch.Nodes.JsonNodes.JsonToList(json=watch)
watch_2 = Watch(jsonToList)
firstItem = List.FirstItem(list=watch_2)
code_block = CodeBlock { "name"; "email"; "address"; }
valueAtKey = DesignScript.Builtin.Dictionary.ValueAtKey(dictionary=firstItem, key=code_block.out0)
watch_3 = Watch(valueAtKey)
valueAtKey_2 = DesignScript.Builtin.Dictionary.ValueAtKey(dictionary=firstItem, key=code_block.out1)
watch_4 = Watch(valueAtKey_2)
valueAtKey_3 = DesignScript.Builtin.Dictionary.ValueAtKey(dictionary=firstItem, key=code_block.out2)
watch_5 = Watch(valueAtKey_3)
code_block_2 = CodeBlock { "street"; "city"; "zipcode"; }
valueAtKey_4 = DesignScript.Builtin.Dictionary.ValueAtKey(dictionary=watch_5, key=code_block_2.out0)
watch_6 = Watch(valueAtKey_4)
valueAtKey_5 = DesignScript.Builtin.Dictionary.ValueAtKey(dictionary=watch_5, key=code_block_2.out1)
watch_7 = Watch(valueAtKey_5)
valueAtKey_6 = DesignScript.Builtin.Dictionary.ValueAtKey(dictionary=watch_5, key=code_block_2.out2)
watch_8 = Watch(valueAtKey_6)

# group: Build & Execute
GET_2 = DynaFetch.Nodes.ExecuteNodes.GET(client=create, url=string_2)

# group: Response
watch_9 = Watch(GET_2)

# group: Deserialise JSON to dictionary
toDictionary = DynaFetch.Nodes.JsonNodes.ToDictionary(response=watch_9)
watch_10 = Watch(toDictionary)
code_block_3 = CodeBlock { "name"; "username"; "email"; "phone"; "address"; }
valueAtKey_7 = DesignScript.Builtin.Dictionary.ValueAtKey(dictionary=watch_10, key=code_block_3.out0)
watch_11 = Watch(valueAtKey_7)
valueAtKey_8 = DesignScript.Builtin.Dictionary.ValueAtKey(dictionary=watch_10, key=code_block_3.out2)
watch_12 = Watch(valueAtKey_8)
valueAtKey_9 = DesignScript.Builtin.Dictionary.ValueAtKey(dictionary=watch_10, key=code_block_3.out1)
watch_13 = Watch(valueAtKey_9)
valueAtKey_10 = DesignScript.Builtin.Dictionary.ValueAtKey(dictionary=watch_10, key=code_block_3.out3)
watch_14 = Watch(valueAtKey_10)
valueAtKey_11 = DesignScript.Builtin.Dictionary.ValueAtKey(dictionary=watch_10, key=code_block_3.out4)
watch_15 = Watch(valueAtKey_11)
code_block_4 = CodeBlock { "street"; "city"; "suite"; }
valueAtKey_12 = DesignScript.Builtin.Dictionary.ValueAtKey(dictionary=watch_15, key=code_block_4.out0)
watch_16 = Watch(valueAtKey_12)
valueAtKey_13 = DesignScript.Builtin.Dictionary.ValueAtKey(dictionary=watch_15, key=code_block_4.out1)
watch_17 = Watch(valueAtKey_13)
valueAtKey_14 = DesignScript.Builtin.Dictionary.ValueAtKey(dictionary=watch_15, key=code_block_4.out2)
watch_18 = Watch(valueAtKey_14)
