# Dynamo graph 5 - REST API Advanced-DynaFetch.dyn (Dynamo 3.5.2.8856)

# group: Input
# note: DynaFetch Migration Sample
# Original: "Dynamo 2.0 - REST API Advanced" from DynaWeb
# This graph recreates the original Dynamo 2.0 sample from DynaWeb using DynaFetch nodes.
# DynaFetch is a modern REST API package that works with Dynamo 3.0+ and provides the
# same functionality as DynaWeb with improved performance and simplified workflows.
# This sample demonstrates POST requests with JSON data submission and response processing.
# Original DynaWeb sample by Radu Gidei - recreated for DynaFetch compatibility.
create = DynaFetch.Nodes.ClientNodes.Create()
string_posts_api_url = StringInput("https://jsonplaceholder.typicode.com/posts")
string_post_data_json = StringInput("""{
  "title": "DynaFetch Test Post",
  "body": "This is a test post created with DynaFetch",
  "userId": 1
}""")

# group: Build & Execute
POST = DynaFetch.Nodes.ExecuteNodes.POST(client=create, url=string_posts_api_url, jsonData=string_post_data_json)
toDictionary = DynaFetch.Nodes.JsonNodes.ToDictionary(response=POST)
getContent = DynaFetch.Nodes.JsonNodes.GetContent(response=POST)

# group: Response
watch = Watch(toDictionary)
watch_2 = Watch(getContent)

# group: Deserialise
code_block = CodeBlock { "id"; "title"; "body"; }
valueAtKey = DesignScript.Builtin.Dictionary.ValueAtKey(dictionary=watch, key=code_block.out0)
watch_3 = Watch(valueAtKey)
valueAtKey_2 = DesignScript.Builtin.Dictionary.ValueAtKey(dictionary=watch, key=code_block.out1)
watch_4 = Watch(valueAtKey_2)
valueAtKey_3 = DesignScript.Builtin.Dictionary.ValueAtKey(dictionary=watch, key=code_block.out2)
watch_5 = Watch(valueAtKey_3)
