# Dynamo graph 6 - Complex-POST-Request-DynaFetch.dyn (Dynamo 3.5.2.8856)

# group: Input
# note: DynaFetch Migration Sample
# Original: "Dynamo 2.0 - Complex POST Request" from DynaWeb
# This graph recreates the original Dynamo 2.0 sample from DynaWeb using DynaFetch nodes.
# DynaFetch is a modern REST API package that works with Dynamo 3.0+ and provides the
# same functionality as DynaWeb with improved performance and simplified workflows.
# This sample demonstrates complex POST requests with custom headers and JSON data submission.
# Note: DynaFetch uses client-level header configuration rather than request-level building,
# which simplifies the workflow while achieving the same result.
# Original DynaWeb sample by Radu Gidei - recreated for DynaFetch compatibility.
create = DynaFetch.Nodes.ClientNodes.Create()
string_http_bin_post_url = StringInput("https://httpbin.org/post")
string_complex_json_data = StringInput("""{
  "project": "Building Information Model",
  "software": "Dynamo",
  "package": "DynaFetch",
  "timestamp": "2025-08-24",
  "data": {
    "nodes": 15,
    "connections": 22,
    "status": "active"
  }
}""")

# group: Build & Execute
code_block = CodeBlock { "X-API-Source"; "DynaFetch-Migration"; }
addDefaultHeader = DynaFetch.Nodes.ClientNodes.AddDefaultHeader(client=create, headerName=code_block.out0, headerValue=code_block.out1)
code_block_2 = CodeBlock { "Authorization"; "Bearer sample-token"; }
addDefaultHeader_2 = DynaFetch.Nodes.ClientNodes.AddDefaultHeader(client=addDefaultHeader, headerName=code_block_2.out0, headerValue=code_block_2.out1)

# group: Response
POST = DynaFetch.Nodes.ExecuteNodes.POST(client=addDefaultHeader_2, url=string_http_bin_post_url, jsonData=string_complex_json_data)
watch = Watch(POST)

# group: Deserialise
toDictionary = DynaFetch.Nodes.JsonNodes.ToDictionary(response=watch)
code_block_3 = CodeBlock { "headers"; "json"; }
valueAtKey = DesignScript.Builtin.Dictionary.ValueAtKey(dictionary=toDictionary, key=code_block_3.out0)
watch_2 = Watch(valueAtKey)
valueAtKey_2 = DesignScript.Builtin.Dictionary.ValueAtKey(dictionary=toDictionary, key=code_block_3.out1)
watch_3 = Watch(valueAtKey_2)
getContent = DynaFetch.Core.HttpResponse.GetContent(httpResponse=watch)
watch_4 = Watch(getContent)
