# Dynamo graph 7 - GET ACC Projects and Users-DynaFetch.dyn (Dynamo 3.5.2.8856)

# note: DynaFetch Migration Sample
# Original: "Dynamo 2.0 - 7 - Upload file to Autodesk Forge" from DynaWeb
# This graph modernizes the original Dynamo 2.0 sample from DynaWeb using DynaFetch nodes and current APS (Autodesk Platform Services) APIs. DynaFetch is a modern REST API package that works with Dynamo 3.0+ and provides the same functionality as DynaWeb with improved performance and simplified workflows.
# This sample demonstrates real-world APS integration patterns including:
# - Modern Bearer token authentication with persistent client headers
# - Multi-step API workflows with data dependency chains
# - List processing for user selection interfaces (projects and users)
# - Complex JSON response handling with parallel data extraction
# - Professional error handling patterns for production workflows
# note: Note: This sample updates from deprecated Forge APIs to current APS endpoints, reflecting modern Autodesk Platform Services architecture. The workflow demonstrates practical patterns for ACC project and user management that can be extended to other APS APIs.
# References:
# - Postman Collection: https://github.com/autodesk-platform-services/aps-acc.issues.api-postman.collection
# - ACC API Documentation: https://aps.autodesk.com/en/docs/acc/v1/overview/introduction/
# Original DynaWeb sample by Radu Gidei - recreated for DynaFetch compatibility with modern APS APIs.
# note: 7 - GET ACC Projects and Users-DynaFetch
# An APS ACC Issues API Integration Sample
# This workflow demonstrates modern APS (Autodesk Platform Services)
# integration using DynaFetch nodes. Based on real-world ACC API patterns
# for project and user management workflows.
# References:
# - Postman Collection: https://github.com/autodesk-platform-services/aps-acc.issues.api-postman.collection
# - ACC API Documentation: https://aps.autodesk.com/en/docs/acc/v1/overview/introduction/
# Users can extend this pattern for any APS API endpoint by following
# the same authentication and response processing structure shown here.
# Additional API endpoints and workflows available in the Postman collection.

# group: ACC URL Calls
acc_projects_url = StringInput("https://developer.api.autodesk.com/construction/admin/v1/accounts/YOUR_ACCOUNT_ID/projects")
acc_project_url = StringInput("https://developer.api.autodesk.com/construction/admin/v1/projects/PROJECT_ID")
acc_project_users_url = StringInput("https://developer.api.autodesk.com/construction/admin/v1/projects/PROJECT_ID/users")
acc_project_user_url = StringInput("https://developer.api.autodesk.com/construction/admin/v1/projects/PROJECT_ID/users/USER_ID")

# group: Input
create = DynaFetch.Nodes.ClientNodes.Create()
code_block = CodeBlock { "Authorization"; "Bearer "; }
acc_bearer_token = StringInput("YOUR_ACC_BEARER_TOKEN_HERE")
# note: APS  (The APIs behind ACC) Bearer Token Authentication
# Modern APS authentication requires Bearer token format:
# - Raw token input (no "Bearer" prefix)
# - String.Concat adds "Bearer " prefix automatically
# - ClientNodes.AddDefaultHeader persists authentication across all requests
# - Single authentication setup works for entire workflow
# Authentication pattern: Token → "Bearer " + Token → Client Header
# This client-level auth approach follows DynaFetch best practices.
# Reference: APS Authentication Guide
# https://aps.autodesk.com/en/docs/acc/v1/overview/introduction/e
concat = String.Concat(string0=code_block.out1, string1=acc_bearer_token)
addDefaultHeader = DynaFetch.Nodes.ClientNodes.AddDefaultHeader(client=create, headerName=code_block.out0, headerValue=concat)

# group: Input - Get ACC Projects
acc_projects_url_2 = StringInput("https://developer.api.autodesk.com/construction/admin/v1/accounts/YOUR_ACCOUNT_ID/projects")

# group: Build & Execute - Get ACC Projects
GET = DynaFetch.Nodes.ExecuteNodes.GET(client=addDefaultHeader, url=acc_projects_url_2)
toDictionary = DynaFetch.Nodes.JsonNodes.ToDictionary(response=GET)

# group: Response - Get ACC Projects
watch = Watch(toDictionary)

# group: Deserialise - Get ACC Projects
code_block_2 = CodeBlock { "results"; }
valueAtKey = DesignScript.Builtin.Dictionary.ValueAtKey(dictionary=watch, key=code_block_2)
# note: APS APIs to for ACC Projects Collection
# Retrieves all projects in account with name/ID pairs for selection:
# - URL: /construction/admin/v1/accounts/{account}/projects
# - Response structure: {"pagination": {...}, "results": [projects]}
# - Extract "results" array from response object
# - Generate parallel lists: project names and project IDs
# List.Map pattern efficiently processes arrays for user selection.
# Perfect for building project picker interfaces in larger workflows.
# Reference: ACC API Documentation
# https://aps.autodesk.com/en/docs/acc/v1/overview/introduction/
code_block_3 = CodeBlock { "name"; "id"; }
valueAtKey_2 = DesignScript.Builtin.Dictionary.ValueAtKey(dictionary=valueAtKey, key=code_block_3.out0)
project_names = Watch(valueAtKey_2)
valueAtKey_3 = DesignScript.Builtin.Dictionary.ValueAtKey(dictionary=valueAtKey, key=code_block_3.out1)
project_ids = Watch(valueAtKey_3)

# group: Input - Get An ACC Project
acc_project_url_2 = StringInput("https://developer.api.autodesk.com/construction/admin/v1/projects/7eb863da-e8e2-4426-a250-69c3233a50fc")

# group: Build & Execute - Get An ACC Project
GET_2 = DynaFetch.Nodes.ExecuteNodes.GET(client=addDefaultHeader, url=acc_project_url_2)
toDictionary_2 = DynaFetch.Nodes.JsonNodes.ToDictionary(response=GET_2)

# group: Response - Get An ACC Project
watch_2 = Watch(toDictionary_2)

# group: Deserialise - Get An ACC Project
# note: Selected Project Details Extraction
# Retrieves comprehensive project information for selected project:
# - URL: /construction/admin/v1/projects/{project_id}
# - Direct object response (no pagination wrapper)
# - Extracts key project metadata: name, location, job number
# - Five parallel Dictionary.ValueAtKey operations for efficiency
# Multiple parallel extractions demonstrate DynaFetch's ability to
# process complex JSON responses into structured Dynamo data.
code_block_4 = CodeBlock { "name"; "country"; "stateOrProvince"; "city"; "jobNumber"; }
valueAtKey_4 = DesignScript.Builtin.Dictionary.ValueAtKey(dictionary=watch_2, key=code_block_4.out0)
project_name = Watch(valueAtKey_4)
valueAtKey_5 = DesignScript.Builtin.Dictionary.ValueAtKey(dictionary=watch_2, key=code_block_4.out1)
project_country = Watch(valueAtKey_5)
valueAtKey_6 = DesignScript.Builtin.Dictionary.ValueAtKey(dictionary=watch_2, key=code_block_4.out2)
project_state_or_province = Watch(valueAtKey_6)
valueAtKey_7 = DesignScript.Builtin.Dictionary.ValueAtKey(dictionary=watch_2, key=code_block_4.out3)
project_city = Watch(valueAtKey_7)
valueAtKey_8 = DesignScript.Builtin.Dictionary.ValueAtKey(dictionary=watch_2, key=code_block_4.out4)
project_job_number = Watch(valueAtKey_8)

# group: Input - Get An ACC Project User
acc_project_users_url_2 = StringInput("https://developer.api.autodesk.com/construction/admin/v1/projects/7eb863da-e8e2-4426-a250-69c3233a50fc/users/dad29425-cfd7-440c-a295-05a376d15d38")

# group: Build & Execute - Get An ACC Project User
GET_3 = DynaFetch.Nodes.ExecuteNodes.GET(client=addDefaultHeader, url=acc_project_users_url_2)
toDictionary_3 = DynaFetch.Nodes.JsonNodes.ToDictionary(response=GET_3)

# group: Deserialise - Get An ACC Project User
watch_3 = Watch(toDictionary_3)

# group: Deserialise - Get An ACC Project User
# note: Selected User Profile Details
# Retrieves comprehensive user information for selected user:
# - URL: /construction/admin/v1/projects/{project_id}/users/{user_id}
# - Direct object response with detailed user profile
# - Extracts personal and professional information
# - Six parallel extractions demonstrate complex data processing
# This pattern handles nested user objects efficiently,
# showing how DynaFetch scales to detailed API responses.
# Reference: ACC API Documentation
# https://aps.autodesk.com/en/docs/acc/v1/overview/introduction/
code_block_5 = CodeBlock { "firstName"; "lastName"; "country"; "stateOrProvince"; "city"; "email"; "industry"; "companyName"; }
valueAtKey_9 = DesignScript.Builtin.Dictionary.ValueAtKey(dictionary=watch_3, key=code_block_5.out2)
users_country = Watch(valueAtKey_9)
valueAtKey_10 = DesignScript.Builtin.Dictionary.ValueAtKey(dictionary=watch_3, key=code_block_5.out1)
users_last_name = Watch(valueAtKey_10)
valueAtKey_11 = DesignScript.Builtin.Dictionary.ValueAtKey(dictionary=watch_3, key=code_block_5.out4)
users_city = Watch(valueAtKey_11)
valueAtKey_12 = DesignScript.Builtin.Dictionary.ValueAtKey(dictionary=watch_3, key=code_block_5.out3)
users_state_or_procvince = Watch(valueAtKey_12)
valueAtKey_13 = DesignScript.Builtin.Dictionary.ValueAtKey(dictionary=watch_3, key=code_block_5.out0)
users_first_name = Watch(valueAtKey_13)
valueAtKey_14 = DesignScript.Builtin.Dictionary.ValueAtKey(dictionary=watch_3, key=code_block_5.out5)
users_email = Watch(valueAtKey_14)
valueAtKey_15 = DesignScript.Builtin.Dictionary.ValueAtKey(dictionary=watch_3, key=code_block_5.out6)
users_industry = Watch(valueAtKey_15)
valueAtKey_16 = DesignScript.Builtin.Dictionary.ValueAtKey(dictionary=watch_3, key=code_block_5.out7)
users_company_name = Watch(valueAtKey_16)

# group: Input - Get ACC Project Users
acc_project_users_url_3 = StringInput("https://developer.api.autodesk.com/construction/admin/v1/projects/7eb863da-e8e2-4426-a250-69c3233a50fc/users")

# group: Build & Execute - Get ACC Project Users
GET_4 = DynaFetch.Nodes.ExecuteNodes.GET(client=addDefaultHeader, url=acc_project_users_url_3)
toDictionary_4 = DynaFetch.Nodes.JsonNodes.ToDictionary(response=GET_4)

# group: Response - Get ACC Project Users
watch_4 = Watch(toDictionary_4)

# group: Deserialise - Get ACC Project Users
# note: Project Users Collection
# Retrieves all users assigned to selected project:
# - URL: /construction/admin/v1/projects/{project_id}/users
# - Response structure: {"pagination": {...}, "results": [users]}
# - List.Flatten required for proper array processing
# - Generate user name/ID pairs for selection
# Same pattern as projects list but with additional flatten step
# for consistent data structure handling.
code_block_6 = CodeBlock { "results"; }
valueAtKey_17 = DesignScript.Builtin.Dictionary.ValueAtKey(dictionary=watch_4, key=code_block_6)
code_block_7 = CodeBlock { "name"; "id"; }
valueAtKey_18 = DesignScript.Builtin.Dictionary.ValueAtKey(dictionary=valueAtKey_17, key=code_block_7.out0)
project_users_names = Watch(valueAtKey_18)
valueAtKey_19 = DesignScript.Builtin.Dictionary.ValueAtKey(dictionary=valueAtKey_17, key=code_block_7.out1)
project_users_ids = Watch(valueAtKey_19)
